# Grasshopper definition skinPattern.ghx (Grasshopper 1.0.7)
# plug-ins: ScriptParasite

ziteration = Slider(54, range=0..300)
maxradius = Slider(7, range=0..10)
mimradius = Slider(1, range=0..10)
filletratio = Slider(0.38, range=0..1)
reset = Button()
curve = Curve(<curve referenced from the Rhino model>)
point = Point(<point referenced from the Rhino model>)
number_slider = Slider(0, range=0..100)
number_slider_2 = Slider(0, range=0..100)
number_slider_3 = Slider(57, range=0..100)
number_slider_4 = Slider(52, range=0..100)
number_slider_5 = Slider(27, range=0..100)
number_slider_6 = Slider(39, range=0..100)
geometry = Geometry(<curve referenced from the Rhino model>)
geometry_2 = Geometry(<curve referenced from the Rhino model>)
construct_point = ConstructPoint(XCoordinate=number_slider, YCoordinate=number_slider_2, ZCoordinate=0)
divide_curve = DivideCurve(Count=10, Kinks=False)  # -> Points, Tangents, Parameters
construct_point_2 = ConstructPoint(XCoordinate=number_slider_3, YCoordinate=number_slider_4, ZCoordinate=0)
tangent_lines_in = TangentLinesIn(CircleA=geometry, CircleB=geometry_2)  # -> Tangent1, Tangent2
tangent_lines_ex = TangentLinesEx(CircleA=geometry, CircleB=geometry_2)  # -> Tangent1, Tangent2
circle = Circle(Plane=construct_point, Radius=number_slider_6)
circle_2 = Circle(Plane=construct_point_2, Radius=number_slider_5)
number_slider_7 = Slider(10, range=0..10)
c_script = CSharpScript(x=number_slider_3, z=number_slider_4, y=number_slider_5, u=number_slider, v=number_slider_2, w=number_slider_6)  # -> out, A; inputs x: Double, z: Double, y: Double, u: Double, v: Double, w: Double
# ---------- c_script: C# ----------
    List<Point2d>X = new List<Point2d>();

    X = getTangentPoint(x, z, y, u, v, w);
    
    A = X;
# ---------- c_script: C# additional code ----------
  /// <summary>
  /// 计算两个相离的圆的内公切线。（相交没有内公切线，只有外公切线）
  /// 圆C1, 圆心(a, b), 半径r1.
  /// 圆C2, 圆心(c, d), 半径r2.
  /// </summary>
  /// <returns>返回两条内公切线段，线段的两个端点是圆上的切点。</returns>

  List<Point2d> getTangentPoint(double a, double b, double r1, double c, double d, double r2)
  {
    Point2d r2_low_point = new Point2d();
    Point2d r2_up_point = new Point2d();
    Point2d r1_up_point = new Point2d();
    Point2d r1_low_point = new Point2d();


    double k = Math.Atan2((b - d), (a - c));    //求中两个圆心连线的斜率角度
    double centerLine;
    if (d == b)                            //处理斜率为零的情况
    {
      if (a < c)
      {
        centerLine = a - c;

      }
      else
      {
        centerLine = c - a;
      }
    }
    else
    {
      centerLine = (d - b) / Math.Sin(k); //求两个圆心连线长度
    }
    double l = Math.Acos((r1 + r2) / centerLine);  //求两个圆心连线和圆心到切点垂线的夹角
    double m = l - k;
    double r2LowX = r2 * Math.Cos(m);
    double r2LowY = r2 * Math.Sin(m);
    double r1UpX = r1 * Math.Cos(m);
    double r1UpY = r1 * Math.Sin(m);
    r2_low_point.X = c - (double) r2LowX;
    r2_low_point.Y = d + (double) r2LowY;
    r1_up_point.X = a + (double) r1UpX;
    r1_up_point.Y = b - (double) r1UpY;
    Point2d r2_tempoint = Transition(r2_low_point.X - c, r2_low_point.Y - d, 2 * l, 1);
    r2_up_point.X = c + r2_tempoint.X;
    r2_up_point.Y = d + r2_tempoint.Y;
    Point2d r1_tempoint = Transition(r1_up_point.X - a, r1_up_point.Y - b, 2 * l, 1);
    r1_low_point.X = a + r1_tempoint.X;
    r1_low_point.Y = b + r1_tempoint.Y;


    List<Point2d> outPoints = new List<Point2d>();

    outPoints.Add(r2_low_point);
    outPoints.Add(r2_up_point);
    outPoints.Add(r1_up_point);
    outPoints.Add(r1_low_point);

    return outPoints;
  }
  //点绕点旋转
  private Point2d Transition(double _x, double _y, double _angle, int fx)
  {
    double newX = 0;
    double newY = 0;
    if (fx == 1)
    {
      newX = _x * Math.Cos(_angle) - _y * Math.Sin(_angle);
      newY = _x * Math.Sin(_angle) + _y * Math.Cos(_angle);
    }
    else
    {
      newX = _x * Math.Cos(_angle) + _y * Math.Sin(_angle);
      newY = _y * Math.Cos(_angle) - _x * Math.Sin(_angle);
    }
    return new Point2d((double) newX, (double) newY);
  }
# ---------- end c_script ----------
list_item = ListItem(List=c_script.A, Index=0, Wrap=True)  # -> Item, Item1, Item2, Item3
tangent_arcs = TangentArcs(CircleA=circle_2, CircleB=circle, Radius=Slider(73, range=0..100))  # -> ArcA, ArcB
panel = Panel(c_script.out)
line = Line(StartPoint=list_item.Item, EndPoint=list_item.Item2)

panel_2 = Panel("skinPattern\skinPattern.py")  # disabled
ghpython_script = GhPythonScript(file_name=panel_2)  # -> path; disabled
# ---------- ghpython_script: Python ----------
a = ghdoc.Path

path = a.split('3d_printing_teamwork')[0]+r'3d_printing_teamwork\\'+file_name
# ---------- end ghpython_script ----------
read_file = ReadFile(File=ghpython_script, PerLineParse=False)  # disabled

curve_2 = Curve(<curve referenced from the Rhino model>)
divide_curve_2 = DivideCurve(Curve=curve_2, Count=Slider(50, range=0..100), Kinks=False)  # -> Points, Tangents, Parameters

c_script_2 = CSharpScript(
    Points=divide_curve_2.Points,
    Iteration=ziteration,
    MaxRadius=maxradius,
    MinRadius=mimradius,
    AttractPoint=point,
    Edge=curve,
    MaxCount="200",
    FilletRatio=filletratio)  # -> out, OutPoints, Radiuses, OutTemp; inputs Points: list of Point3d, Iteration: Double, MaxRadius: Double, MinRadius: Double, AttractPoint: Point3d, Edge: Curve, MaxCount: Int32, FilletRatio: Double
# ---------- c_script_2: C# ----------
    // !Initialization
    List<Circle> circles = new List<Circle>();
    List<double> radiuses = new List<double>();


    for (int i = 0; i < Points.Count; i++)
    {
      radiuses.Add(Remap(Points[i].DistanceTo(AttractPoint), 20, 0, MinRadius, MaxRadius));
    }

    //!Iteration
    for (int iteration = 0; iteration < Iteration; iteration++)
    {

      List<Vector3d> totalVector = new List<Vector3d>();
      List<double> counts = new List<double>();
      for (int i = 0; i < Points.Count; i++)
      {
        totalVector.Add(new Vector3d(0, 0, 0));
        counts.Add(0);
      }

      for (int i = 0; i < Points.Count; i++)
        for (int j = i + 1; j < Points.Count; j++)
        {
          double distance = Points[i].DistanceTo(Points[j]);
          if (radiuses[i] + radiuses[j] > distance)
          {

            Vector3d subVector = Points[i] - Points[j];
            subVector.Unitize();
            subVector *= 1 * (radiuses[i] + radiuses[j] - distance);
            // subVector *= 0.5 / distance;
            // subVector *= 
            totalVector[i] += subVector;
            totalVector[j] -= subVector;
            counts[i] += 1;
            counts[j] += 1;

          }


        }


      for (int k = 0; k < Points.Count; k++)
        if (counts[k] != 0)
        {
          if (Edge.Contains(Points[k], Plane.WorldXY, 0.01) == PointContainment.Inside)
          {
            Vector3d move = totalVector[k] / counts[k];
            // Vector3d move = totalVector[k] ;
            Points[k] += move;
          }

        }

      //! Add points
      if (Points.Count < MaxCount)
      {
        List<int> Indices = new List<int>();

        for (int i = 0; i < Points.Count - 1; i++)
        {
          if (Points[i].DistanceTo(Points[i + 1]) > radiuses[i] + radiuses[i + 1])
          { Indices.Add(i + 1 + Indices.Count); }
        }
        foreach (int Index in Indices)
        {
          if (Points.Count < MaxCount)
          {
            Point3d addPoint = 0.5 * (Points[Index - 1] + Points[Index]);
            Points.Insert(Index, addPoint);
          }
        }
      }


      // ! Generate the radius
      radiuses = new List<double>();
      for (int i = 0; i < Points.Count; i++)
      {
        radiuses.Add(Remap(Points[i].DistanceTo(AttractPoint), 20, 0, MinRadius, MaxRadius));
      }

      // Print(totalVector[54].Length.ToString());
    }


    //! Make curve




    //!Info
    Print("Points.Count =" + Points.Count.ToString());
    // ! Output
    // zOutTemp = curves;
    OutPoints = Points;
    Radiuses = radiuses;
# ---------- c_script_2: C# additional code ----------
  bool IsLinear(Point3d p0, Point3d p1, Point3d p2)
  {

    Vector3d v1 = new Vector3d(p1 - p0);
    Vector3d v2 = new Vector3d(p2 - p1);

    double x = v1.X / v2.X;

    if (v1.Y / v2.Y == x && v1.Z / v2.Z == x) { return true; }
    else return false;
  }
  double Remap(double x, double t1, double t2, double s1, double s2)
  {
    double mapped = (s2 - s1) / (t2 - t1) * (x - t1) + s1;
    if (mapped < s1) mapped = s1;
    if (mapped > s2) mapped = s2;
    return mapped;
    // return (x - t1) / (t2 - t1) * (s2 - s1) + s1;
  }
# ---------- end c_script_2 ----------
script_parasite = ScriptParasite(Enable=Toggle(True), Folder="C:\Zac\GitHub\3d_printing_teamwork\skinPattern\csharp")

ghpython_script_2 = GhPythonScript(Code=read_file, Points=divide_curve_2.Points, Reset=reset, Radius=maxradius, Edge=curve, MaxCounts="200")  # -> Out, OutPoints; disabled
panel_3 = Panel(ghpython_script_2.Out)  # disabled

panel_4 = Panel(c_script_2.out)

polyline = PolyLine(Vertices=c_script_2.OutPoints, Closed=False)
geometry_3 = Geometry(c_script_2.OutTemp)
circle_3 = Circle(Plane=c_script_2.OutPoints, Radius=c_script_2.Radiuses)
